vi "Reset Aggregates.gvi"   [LabVIEW Platform Developer Preview 0.1.0]
inputs:
  "Server": string
  "Tag": string
diagram:
  Concatenate Strings("http://", $Server, "/nitag/tag/", $Tag, "/reset_aggregates") -> w1
  call "WebVI_PostBuffer.gvi"(Client Handle In=0, Url In=w1, Output File In="", Buffer In="", Time Out In=30000, Error Code In=0, Error Message In="")
