vi "Update Tag (Double).gvi"   [LabVIEW Platform Developer Preview 0.1.0]
inputs:
  "Server": string
  "Tag": string
  "Tag Value": f64
outputs:
  "URI": string
  "Body": string
  "Headers Out": string
panel controls:
  "Cluster Constant": T1
panel indicators:
  "Body Out": string
types:
  T1 = cluster{"Value": cluster{"Type": string, "Value": string}, "Timestamp": string}
diagram:
  Format Into String(formatString="%f", $"Tag Value") -> w1
  Property Node(instance in=$"Cluster Constant", "Timestamp"="0001-01-01T00:00:00", "Value:Type"="Double", "Value:Value"=w1) -> (instance out=w2)
  Flatten To JSON(anything=w2) -> (JSON string=w3)
  $Body <- w3
  Concatenate Strings("http://", $Server, "/nitag/tag/", $Tag, "/timestamped_value") -> w4
  $URI <- w4
  call "WebVI_PutBuffer.gvi"(Client Handle In=0, Url In=w4, Buffer In=w3, Output File In="", Time Out In=10000, Error Code In=0, Error Message In="") -> (Headers Out=w5, Body Out=w6)
  $"Headers Out" <- w5
  $"Body Out" <- w6
